# Grasshopper definition test_double_roundtrip.gh (Grasshopper 1.0.7)

pt = Point(<point referenced from the Rhino model>)
pdecon = Deconstruct(Point=pt)  # -> XComponent, YComponent, ZComponent
c_script = CSharpScript(x=pdecon.XComponent)  # -> out, A, B, C, D, E; inputs x: Double
# ---------- c_script: C# usings ----------
using System.Globalization;
# ---------- c_script: C# ----------
A = x.ToString("e16", CultureInfo.InvariantCulture);
B = x.ToString();
C = x;
D = x.ToString("g17", CultureInfo.InvariantCulture);
E = x.ToString("r", CultureInfo.InvariantCulture);
# ---------- end c_script ----------
panel = Panel(c_script.D)
panel_2 = Panel(c_script.E)
panel_3 = Panel(c_script.A)
panel_4 = Panel(c_script.B)
c_script_2 = CSharpScript(x=panel)  # -> out, A; inputs x: String
# ---------- c_script_2: C# ----------
A = Double.Parse(x);
# ---------- end c_script_2 ----------
c_script_3 = CSharpScript(x=panel_3)  # -> out, A; inputs x: String; same code as c_script_2
num = Number(panel_4)
c_script_4 = CSharpScript(x=panel_2)  # -> out, A; inputs x: String; same code as c_script_2
equals = Equality(FirstNumber=c_script_3.A, SecondNumber=c_script.C)  # -> Equality, Inequality
equals_2 = Equality(FirstNumber=num, SecondNumber=c_script.C)  # -> Equality, Inequality
equals_3 = Equality(FirstNumber=c_script_4.A, SecondNumber=c_script.C)  # -> Equality, Inequality
equals_4 = Equality(FirstNumber=c_script_2.A, SecondNumber=c_script.C)  # -> Equality, Inequality
panel_5 = Panel(equals.Equality)
panel_6 = Panel(equals_2.Equality)
panel_7 = Panel(equals_4.Equality)
panel_8 = Panel(equals_3.Equality)
