# Grasshopper definition 3DCPgh.gh (Grasshopper 1.0.8)
# Copyright: © 2025 Filipe J.S. Brandão
# plug-ins: Pondskater

arena_theoretical_mfv_mm_s = Slider(137, range=0..450)
layer_width = Slider(34.74, range=15..41)
nozzle_diameter_mm = Slider(15, range=5..30)
nozzle_height = Slider(8.2, range=4..15)
_3dcpspeed = _3DCPVelocity(
    MaterialExtrusionVelocity=arena_theoretical_mfv_mm_s,
    NozzleDiameter=nozzle_diameter_mm,
    FilamentWidth=layer_width,
    NozzleHeight=nozzle_height)  # -> NozzleVelocity, ContactWidth, HeightRatio, WidthRatio
panel = Panel(_3dcpspeed.NozzleVelocity)
panel_2 = Panel(_3dcpspeed.WidthRatio)
panel_3 = Panel(_3dcpspeed.HeightRatio)
