# Grasshopper definition BridgesWithTrees.gh (Grasshopper 1.0.8)
# Copyright: © 2025 Filipe J.S. Brandão
# plug-ins: Heteroptera, Pondskater

panel = Panel("Works with curves")
curvecells = Curve([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])

trigrid = Triangular(Plane=PlaneXY(0, 0, 0), Size=1, ExtentX=5, ExtentY=5)  # -> Cells, Points

# ----
# Does not work with polygons with holes
cellswithholes = Curve([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])

crv = Curve([<curve referenced from the Rhino model> x4])
hexgrid = Hexagonal(Plane=PlaneXY(0, 0, 0), Size=1, ExtentX=5, ExtentY=5)  # -> Cells, Points
recgrid = Rectangular(Plane=PlaneXY(0, 0, 0), SizeX=1, SizeY=2, ExtentX=10, ExtentY=5)  # -> Cells, Points
area = Area(Geometry=crv)  # -> Area, Centroid
topoly = CurveToPolyline(Curve=crv, ToleranceDistance=0, ToleranceAngle=Slider(0.1, range=0..0.1))  # -> Polyline, Segments
area_2 = Area(Geometry=curvecells)  # -> Area, Centroid
adjacency = TopologyOfAdjacencies(Polylines=flatten(curvecells), Method=2, Tolerance=0.01)
mst = MinimumSpanningTree(BasePoints=flatten(area.Centroid), delu=True, prim=False)  # -> NodeNode, EdgeNode, Lines
sk2d = Skeleton2d(Polyline=topoly.Polyline, Type=True, Direction=0)  # -> Skeleton, IpeOutput
mst_2 = MinimumSpanningTree(BasePoints=flatten(area_2.Centroid), delu=True, prim=False)  # -> NodeNode, EdgeNode, Lines
dualgraph = DualGraph(Polygons=flatten(curvecells))  # -> DualGraph, Vertices, Centers, NodeNode, CellCell
celltreebridge = BridgeCellTree(Cells=flatten(curvecells), Neighbors=mst_2.NodeNode, Width=Slider(0.2, range=0..1), InsetCells=invert(False))  # -> Boundaries, Connections
mst_3 = MinimumSpanningTree(BasePoints=flatten(area_2.Centroid), NodeNode=adjacency, delu=True, prim=False)  # -> NodeNode, EdgeNode, Lines
explode = Explode(Curve=celltreebridge.Boundaries, Recursive=True)  # -> Segments, Vertices
item = ListItem(List=explode.Segments, Index=Slider(100, range=0..100), Wrap=True)
