# Grasshopper definition LimitCases.gh (Grasshopper 1.0.8)
# Copyright: © 2025 Filipe J.S. Brandão
# plug-ins: Heteroptera, Pondskater

crv = Curve([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])
dualgraph = DualGraph(Polygons=crv)  # -> DualGraph, Vertices, Centers, NodeNode, CellCell
adjacency = TopologyOfAdjacencies(Polylines=crv, Method=2, Tolerance=0.01)
area = Area(Geometry=crv)
item = ListItem(List=area, Index=adjacency, Wrap=True)
ln = Line(StartPoint=area, EndPoint=item)  # -> flatten(Line)
mst = MinimumSpanningTree(BasePoints=area, NodeNode=adjacency, delu=True, prim=False)  # -> NodeNode, EdgeNode, Lines
h_path = HamiltonianPath(Curves=ln, UseExact=True, Tolerance=0.01)  # -> Points, Path, Full
celltreebridge = BridgeCellTree(Cells=crv, Neighbors=mst.NodeNode, Width=Slider(1.111, range=0..10), InsetCells=invert(False))  # -> Boundaries, Connections
