# Grasshopper definition helper.gh (Grasshopper 1.0.7)
# Copyright: ©filipejsbrandao

# © 2020 Filipe JS Brandão | http://filipebrandao.pt
number_slider = Slider(0.449, range=0..90)
rad = Radians(Degrees=number_slider)
panel = Panel("/Users/filipe/10_VSProjects/GraphML_IO/test/MixedWeights.obj")
cot = CoTangent(Value=rad)
readobj = CSharpScript(file=panel)  # -> out, A; inputs file: String
# ---------- readobj: C# usings ----------
using Rhino.DocObjects;
using Rhino.FileIO;
# ---------- readobj: C# ----------
var doc = RhinoDoc.CreateHeadless("");
  var options = new FileReadOptions()
    {
      BatchMode = true,
      ImportMode = true,
      ImportReferenceMode = false,
      InsertMode = false,
      NewMode = false,
      OpenMode = false,
      ScaleGeometry = false,
      UseScaleGeometry = true
      };
  var objOptions = new FileObjReadOptions(options)
    {
      MapYtoZ = false,
      IgnoreTextures = true,
      UseObjGroupsAs = FileObjReadOptions.UseObjGsAs.IgnoreObjGroups
      };
  FileObj.Read(file, doc, objOptions);
  var meshes = new List<Mesh>();
  foreach (var rhinoObject in doc.Objects.GetObjectList(ObjectType.Mesh))
  {
    var meshObject = rhinoObject as MeshObject;
    if (meshObject == null) continue;
    var mesh = meshObject.Geometry as Mesh;
    if (mesh == null) continue;
    meshes.Add(mesh.DuplicateMesh());
  }
  doc.Dispose();
  A = meshes;
# ---------- end readobj ----------
medges = MeshEdges(Mesh=readobj.A)  # -> NakedEdges, InteriorEdges, NonManifoldEdges
