# Grasshopper definition roofs.gh (Grasshopper 1.0.7)
# Copyright: ©filipejsbrandao
# plug-ins: ClipperComponents, RoomSurveyor

number_slider = Slider(0.1, range=0..2)
# © 2020 Filipe JS Brandão | http://filipebrandao.pt
crv = Curve(<curve referenced from the Rhino model>)
crv_2 = Curve(crv)
slope = Slider(10, range=0..45)
voronoi_cell_precision = Slider(129, range=0..1000)
rad = Radians(Degrees=Slider(29, range=0..45))
cls = Closed(Curve=crv)  # -> Closed, Periodic

# ---- group: Constant slope
c_script = CSharpScript(roofBase=crv_2, slope=rad)  # -> out, A, B; inputs roofBase: Polyline, slope: Double
# ---------- c_script: C# ----------
if(!roofBase.IsClosed || !roofBase.IsValid){return;}

// Unless the polyline intersects itself consequtive slopes will always intersect themselves
// 1 - For constant slopes the intersection of consequtive slopes is the bisetrix of the angle
// 2 - We start solving two consequtive convex corners with the smallest sum of internal angles
// Calculate the intersection of slope n with slope n+1


A = slope;
B = InternalAngles(roofBase, Plane.WorldXY, true);
# ---------- c_script: C# additional code ----------
public List<double> InternalAngles(Polyline poly, Plane curvePlane, bool degrees){
    List<double> angles = new List<double>();
    Point3d startPt = poly[0];
    bool isCCW = IsCCW(poly, curvePlane);

    for (int i = 0; i < poly.Count - 1; i++)
    {
        if (i == 0)
        {
            double angle = AngleAtCorner(poly[i], poly[poly.Count - 2], poly[i + 1]);
            if (!isCCW)
                angle = 2 * Math.PI - angle;
            angles.Add(angle);
        }
        else
        {
            double angle = AngleAtCorner(poly[i], poly[i - 1], poly[i + 1]);
            if (!isCCW)
                angle = 2 * Math.PI - angle;
            angles.Add(angle);
            }
        if (degrees) angles[i] = angles[i] * (360.0 / (2 * Math.PI));
    }
    return angles;
}

/// <summary>
        /// Checks if polygon is CCW oriented.
        /// </summary>
        /// <returns><c>true</c>, if the polygon is Counter Clockwise oriented, <c>false</c> otherwise.</returns>
        /// <param name="poly">A closed polyline that represents the polygon.</param>
        public static bool IsCCW(Polyline poly, Plane plane)
        {
            bool isCCW = false;
            Curve a = poly.ToNurbsCurve();
            if (a.ClosedCurveOrientation(plane) == CurveOrientation.CounterClockwise)
                isCCW = true;

            return isCCW;
        }

        /// <summary>
        /// Calculates the CCW angle at a corner given the previous and the next point
        /// </summary>
        /// <returns>Returns the angle in radians</returns>
        /// <param name="currPt">current corner - the corner</param>
        /// <param name="prevPt">Previous corner - the previous point or the other end of the edge P1 to P0</param>
        /// <param name="nextPt">Next corner - the next point or the other end of the edge P0 tp P2</param>
        private double AngleAtCorner(Point3d currPt, Point3d prevPt, Point3d nextPt)
        {
            double a = currPt.DistanceTo(prevPt);
            double b = currPt.DistanceTo(nextPt);
            double c = prevPt.DistanceTo(nextPt);

            double angle = FindAngleSSS(a, b, c);
            double isLeft = IsLeft(prevPt, nextPt, currPt);

            if (isLeft > 0)
            { // is a concave angle
                angle = 2 * Math.PI - angle;
            }
            else if (Math.Abs(isLeft) < double.Epsilon)
            { // is colinear
                angle = Math.PI;
            }
            return angle;
        }

        /// <summary>
        /// Finds the internal angle of the line with length <paramref name="a"/> with line with length <paramref name="b"/> given the length of the diagonal <paramref name="c"/>.
        /// </summary>
        /// <returns>The internal angle in radians</returns>
        /// <param name="a">The length of first side .</param>
        /// <param name="b">The length of the second side component.</param>
        /// <param name="c">The length of the diagonal</param>
        private double FindAngleSSS(double a, double b, double c)
        {
            return Math.Acos((a * a + b * b - c * c) / (2 * a * b));
        }

        private double IsLeft(Point3d P0, Point3d P1, Point3d P2)
        {
            return ((P1.X - P0.X) * (P2.Y - P0.Y) - (P2.X - P0.X) * (P1.Y - P0.Y));
        }
# ---------- end c_script ----------

# ---- group: For variable slopes
c_script_2 = CSharpScript(roofBase=crv_2, slopes=rad)  # -> out, A; inputs roofBase: Polyline, slopes: list of Double
# ---------- c_script_2: C# ----------
if(!roofBase.IsClosed || !roofBase.IsValid){return;}

//we must deal with lists that are not the same size as the polyline sides

if(slopes.Count < roofBase.SegmentCount){
    int i = roofBase.SegmentCount - slopes.Count;
    for(int j = 0; j < i; j++){
        slopes.Add(slopes[slopes.Count-1]);
    }
}

//Calculate the intersection of slopeA with slopeB

A = slopes;
# ---------- end c_script_2 ----------

# ----
series = Series(Start=number_slider, Step=number_slider, Count=10)
crv_3 = Curve(graft(crv))
cull = CullPattern(List=crv, CullPattern=cls.Closed)
xy = XYPlane(Origin=Point(0, 0, 0))
cls_2 = Closed(Curve=crv_2)  # -> Closed, Periodic
panel = Panel(c_script.B)
topoly = CurveToPolyline(Curve=cull, ToleranceDistance=0, ToleranceAngle=0)  # -> Polyline, Segments
divide = DivideCurve(Curve=crv_3, Count=voronoi_cell_precision, Kinks=False)  # -> Points, Tangents, Parameters
cull_2 = CullPattern(List=crv_2, CullPattern=cls_2.Closed)
Z = UnitZ(Factor=series)
number_slider_2 = Slider(2, range=0..10)
polyoffset = PolylineOffset(Polylines=topoly.Polyline, Distance=series, Plane=xy, Tolerance=0.001, ClosedFillet=2, OpenFillet=2, Miter=0)  # -> Contour, Holes
xy_2 = XYPlane(Origin=Point(0, 0, 0))
topoly_2 = CurveToPolyline(Curve=cull_2, ToleranceDistance=0, ToleranceAngle=0)  # -> Polyline, Segments
end = EndPoints(Curve=topoly.Polyline)  # -> Start, End
voronoi = Voronoi(Points=divide.Points, BruteForceOverride=False)
pcp = PolygonCornerProperties(Polygon=topoly_2.Polyline, Plane=xy_2, Orientation=True)  # -> Type, Turn, Relation
explode = Explode(Curve=topoly_2.Polyline, Recursive=True)  # -> Segments, Vertices
orpoly = OrientPolygon(Polyline=polyoffset.Holes, ReferencePoint=end.Start)  # -> OrientedPolygon, StartPoint
trim = TrimWithRegion(Curve=voronoi, Region=crv_3)  # -> Inside, Outside
move = Move(Geometry=orpoly.OrientedPolygon, Motion=graft(Z))  # -> Geometry, Transform
pi = Pi(Factor="0.5")
lng = ListLength(List=pcp.Relation)
cull_i = CullIndex(List=explode.Vertices, Indices="-1", Wrap=True)
smaller = SmallerThan(FirstNumber=pcp.Relation, SecondNumber=0)  # -> SmallerThan, OrEqualTo
flip = FlipMatrix(Data=move.Geometry)
match = MatchTree(Tree=flip, Guide=graft(topoly.Polyline))
explode_2 = Explode(Curve=trim.Inside, Recursive=True)  # -> Segments, Vertices
repeat = RepeatData(Data="0", Length=lng)
repeat_2 = RepeatData(Data=Slider(2.428, range=0..10), Length=lng)
shift = ShiftList(List=smaller.SmallerThan, Shift="1", Wrap=True)
rotate = Rotate(Geometry=explode.Segments, Angle=pi, Plane=cull_i)  # -> Geometry, Transform
rad_2 = Radians(Degrees=Slider(29, range=0..45))
merge = Merge(Data1=graft(topoly.Polyline), Data2=match)
trim_2 = TrimTree(Tree=explode_2.Segments, Depth="2")  # -> simplify(Tree)
len = Length(Curve=explode.Segments)
p_n_c = PickNChoose(Pattern=smaller.SmallerThan, Stream0=repeat, Stream1=repeat_2)
rotax = RotateAxis(Geometry=rotate.Geometry, Angle=rad_2, Axis=explode.Segments)  # -> Geometry, Transform
p_n_c_2 = PickNChoose(Pattern=shift, Stream0=repeat, Stream1=repeat_2)
colom = CollisionOneMany(Collider=trim_2, Obstacles=crv_3)  # -> Collision, Index
number_slider_3 = Slider(2, range=0..10)
addition = Addition(A=len, B=p_n_c_2)
loft = Loft(Curves=merge, Options={Adjust=False, Closed=False, LoftEnds=0, LoftSimp=0, LoftType=0, Rebuild=10, Refit=0.01})
pl = ConstructPlane(Origin=cull_i, XAxis=explode.Segments, YAxis=rotax.Geometry)
dom = ConstructDomain(DomainStart=0, DomainEnd=Slider(2.275, range=0..10))
dom_2 = ConstructDomain(DomainStart=expr("-x", p_n_c), DomainEnd=addition)
dispatch = Dispatch(List=trim_2, DispatchPattern=colom.Collision)  # -> ListA, ListB
planesrf = PlaneSurface(Plane=pl, XSize=dom_2, YSize=dom)
bbx = BrepBrep(BrepA=graft(planesrf), BrepB=planesrf, UseTasks=True)  # -> Curves, Points
crv_4 = Curve(crv_3)
medial_axis = Geometry(dispatch.ListB)
veins = Geometry(dispatch.ListA)
item = ListItem(List=planesrf, Index=expr("x+1", number_slider_3), Wrap=True)
item_2 = ListItem(List=planesrf, Index=number_slider_3, Wrap=True)
trim_3 = TrimTree(Tree=bbx.Curves, Depth=1)
slope_2 = Slider(0.771, range=0..2)
end_2 = EndPoints(Curve=veins)  # -> Start, End
ccx = CurveCurve()  # -> Points, ParamsA, ParamsB
mcx = MultipleCurves(Curves=trim_3)  # -> Points, IndexA, IndexB, ParamA, ParamB
crv_cp = CurveClosestPoint(Point=end_2.Start, Curve=crv_4)  # -> Point, Parameter, Distance
llx = LineLine()  # -> ParamA, ParamB, PointA, PointB
multiplication = Multiplication(A=crv_cp.Distance, B=slope_2)
Z_2 = UnitZ(Factor=multiplication)
move_2 = Move(Geometry=end_2.Start, Motion=Z_2)  # -> Geometry, Transform
ln = Line(StartPoint=move_2.Geometry, EndPoint=end_2.End)
curvepoint = PointOnCurve(ln, parameter=0.5)
pdecon = Deconstruct(Point=curvepoint)  # -> XComponent, YComponent, ZComponent
larger = LargerThan(FirstNumber=pdecon.ZComponent, SecondNumber="0.1")  # -> LargerThan, OrEqualTo
dispatch_2 = Dispatch(List=ln, DispatchPattern=larger.LargerThan)  # -> ListA, ListB
geo = Geometry(dispatch_2.ListA)
end_3 = EndPoints(Curve=geo)  # -> Start, End
weave = Weave(Pattern=[0, 1], Stream0=end_3.Start, Stream1=end_3.End, NullGaps=False)
del = DelaunayMesh(Points=weave, Plane=PlaneXY(0, 0, 0))
Z_3 = UnitZ(Factor=1)
contour = Contour(Shape=del, Point=Point(0, 0, 0), Direction=Z_3, Distance=Slider(0.093, range=0..1))
