# Grasshopper definition test_GraphML_write.gh (Grasshopper 1.0.7)
# Copyright: ©filipejsbrandao
# plug-ins: GraphML_IO

panel = Panel("/Users/filipe/10_VSProjects/GraphML_IO/test_files/square_weights.graphml")
# © 2020 Filipe JS Brandão | http://filipebrandao.pt
panel_2 = Panel("/Users/filipe/10_VSProjects/GraphML_IO/test_files/square.graphml")
panel_3 = Panel("/Users/filipe/10_VSProjects/CompasWorkshop/mcneel22/surfer2/srpg_octo0000035-random-3.graphml")
panel_4 = Panel("/Users/filipe/10_VSProjects/CompasWorkshop/mcneel22/surfer2/srpg_octo0000035-random-1.graphml")
panel_5 = Panel("/Users/filipe/10_VSProjects/surfer2/surfer2/test-data/issue2/issue2-minimal1.graphml")
pt = ConstructPoint(XCoordinate=0, YCoordinate=0, ZCoordinate=0)
gml = GraphMLToPolyline(Path=panel_5)  # -> Polyline, Weigths
end = EndPoints(Curve=gml.Polyline)  # -> Start, End
subtraction = Subtraction(A=pt, B=end.Start)
move = Move(Geometry=gml.Polyline, Motion=subtraction)  # -> Geometry, Transform
crv = Curve(<curve referenced from the Rhino model>)
write_gml = WriteGraphML(
    Polyline=crv,
    Type=True,
    Dir="/Users/filipe/10_VSProjects/GraphML_IO/test_files/",
    Filename="jaggedpolyline.graphml",
    Save=Button())
