# Grasshopper definition testes.gh (Grasshopper 1.0.7)
# Copyright: ©filipejsbrandao
# plug-ins: LunchBox

series = Series(Start=0, Step=1, Count=10)
# © 2020 Filipe JS Brandão | http://filipebrandao.pt
cull_i = CullIndex(List=series, Indices=Slider(9, range=0..10), Wrap=True)
series_2 = Series(Start=0, Step=1, Count=Slider(1, range=0..10))
crv = Curve([<curve referenced from the Rhino model> x2])
series_3 = Series(Start=0, Step=1, Count=Slider(6, range=0..10))
path = FilePath("/Users/filipe/10_VSProjects/CompasWorkshop/mcneel22/surfer2/convex03.graphml")
pt = ConstructPoint(XCoordinate=cull_i, YCoordinate=0, ZCoordinate=0)
pt_2 = ConstructPoint(XCoordinate=series, YCoordinate=Slider(8, range=0..10), ZCoordinate=0)
panel = Panel("vertex-coordinate-x")
panel_2 = Panel("node")
file = ReadFile(File=path, PerLineParse=True)
entwine = Entwine(Branch00=series_2, Branch01=series_3, FlattenInputs=True)
c_script = CSharpScript(poly=graft(crv), i=entwine)  # -> out, A; inputs poly: Polyline, i: list of Int32
# ---------- c_script: C# ----------
List<TextDot> dots = new List<TextDot>();

if(i.Count > 0){
    if(i.Count < poly.SegmentCount){
        int n = poly.SegmentCount - i.Count;
        int last = i[i.Count - 1];
        for(int m = 0; m < n; m++){
            i.Add(last);
        }
    }
}else{
    return;
}


for(int j = 0; j < poly.SegmentCount; j++){
    var line = new Line(poly[j], poly[j+1]);
    Point3d pt = line.PointAt(0.5);
    TextDot dot = new TextDot(i[j].ToString(), pt);
    dots.Add(dot);
    doc.Objects.AddTextDot(i[j].ToString(), pt);
}


A = dots;
# ---------- c_script: C# additional code ----------
class Test{

    public int X{get; set;}
}
# ---------- end c_script ----------
ln = Line(StartPoint=graft(pt), EndPoint=pt_2)
c_script_2 = CSharpScript(A=pt, B=pt_2)  # -> out, L; inputs A: Point3d, B: Point3d
# ---------- c_script_2: C# ----------
L = new Line(A,B);
# ---------- end c_script_2 ----------
join = TextJoin(Text=file)
panel_3 = Panel(file)
xml = ReadXMLByTag(XML=file, XMLTag="x")  # -> XMLInnerText, XMLInnerXML
panel_4 = Panel(xml.XMLInnerText)
