# Grasshopper definition TestGH.gh (Grasshopper 1.0.8)
# Copyright: © 2025 Filipe J.S. Brandão
# plug-ins: Pondskater, Clipper2

number_slider = Slider(4, range=1..100)
dom = ConstructDomain(DomainStart="-1", DomainEnd=1)
crv_origem = Curve(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)
crv_longe = Curve(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)
explode = Explode(Curve=crv_longe, Recursive=True)  # -> Segments, Vertices
crv_longe_2 = Curve(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)
xy = XYPlane(Origin=Point(0, 0, 0))
crv = Curve([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])
crv_2 = Curve([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])
lng = ListLength(List=explode.Segments)
random = Random(Range=dom, Number=lng, Seed=Slider(146, range=0..1000))
number_slider_2 = Slider(1, range=0..1)
toggle = BooleanToggle(False)
repeat = RepeatData(Data=Slider(1, range=0..1), Length=lng)
list = ValueList({"Inside": 0, "Outside": 1, "Both": 2}, selected="Inside")
number_slider_3 = Slider(0.666, range=0..1)
list_2 = ValueList({"Inside": 0, "Outside": 1, "Both": 2}, selected="Inside")
O = Offset(Polyline=crv_longe, Weights=random, Plane=xy, Type=toggle, Direction=list, Distances="45*1")  # -> Skeleton, Offsets
series = Series(Start=number_slider_2, Step=number_slider_2, Count=Slider(45, range=0..100))
c2offset = Clipper2Offset(Polylines=graft(crv_2), Distance=series, JoinType=0, EndType=0, MiterLimit=2, Precision=8, SVGHeight=600, SVGWidth=800)  # -> Holes, Outer, ClipperPaths
sk2d = Skeleton2d(Polyline=crv_2, Type=toggle, Direction=list_2)  # -> Skeleton, IpeOutput
write_gml = WriteGraphML(
    Polyline=crv_longe,
    Weights=random,
    Type=Toggle(False),
    Dir="/Users/filipeb/10_DEV/GraphML_IO/tests/graphml/weights",
    Filename="additive",
    Save=Toggle(True))
neg = Negative(Value=series)
offset = OffsetCurve(Curve=graft(crv_2), Distance=neg, Plane=xy, Corners=1)
random_2 = Random(Range=Domain(0, 1), Number=lng, Seed=2)
rf = Roofer(Polyline=crv_longe, Slopes=random_2, Plane=xy, Type=True)
